# Grasshopper definition simple_humantosky_utci.gh (Grasshopper 1.0.7)

panel = Panel("http://climate.onebuilding.org/WMO_Region_2_Asia/SAU_Saudi_Arabia/RI_Riyadh/SAU_RI_Riyadh.AB.404380_TMYx.zip")
downloadepw = LBDownloadWeather(weather_URL=panel)  # -> epw_file, stat_file, ddy_file; plug-in component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
importepw = LBImportEPW(epw_file=downloadepw.epw_file)  # -> location, dry_bulb_temperature, dew_point_temperature, relative_humidity, wind_speed, wind_direction, direct_normal_rad, diffuse_horizontal_rad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; plug-in component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
windrose = LBWindRose(data=importepw.wind_speed, wind_direction=importepw.wind_direction)  # -> report, mesh, compass, orient_line, freq_line, windrose_line, legend, title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; plug-in component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
xdata = LBDeconstructData(data=importepw.wind_speed)  # -> header, values; plug-in component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
avr = Average(Input=flatten(xdata.values))
panel_2 = Panel("E:\Current Cases\Grasshopper Plugin")
download = Download(
    project="Outdoor Comfort Example",
    simulation="Pedestrian Wind Comfort",
    run="Run 1",
    resolution="25",
    path=panel_2,
    run_2=Toggle(False))  # -> out
# ---------- download: Python ----------
__author__ = "DarrenLynch"
__version__ = "2021.12.10"

import rhinoscriptsyntax as rs
#Start of GH code
import subprocess

if project == None:
    raise Exception("project name is undefined")
if simulation == None:
    raise Exception("simulation name is undefined")
if run == None:
    raise Exception("run name is undefined")
if path == None:
    raise Exception("path is undefined")
if resolution == None:
    raise Exception(
        "resolution is undefined, should be >=0m, but best bellow 10m")
if _run == None:
    raise Exception("_run is undefined, should be boolean")
if not _run:
    string = "to start downloading, toggle _run to True"
    output = string
    raise Warning(string)
    
    
if _run:
    #Hide the cmd window
    si = subprocess.STARTUPINFO()
    si.dwFlags |= subprocess.STARTF_USESHOWWINDOW
    
    ##call the main cli function to download and process results
    download_return_code = subprocess.Popen(['simscale-eba',
                                        'download-pwc-results',
                                         project,
                                         simulation,
                                         run,
                                         str(resolution),
                                         path], 
                                         stdout=subprocess.PIPE,
                                         stderr=subprocess.PIPE,
                                         startupinfo=si)
    
    output, error = download_return_code.communicate()
    output = output.decode("utf-8")
    error = error.decode("utf-8")
    cleaned_error = error.replace("Exception", "")
    
    if (error != None) and (cleaned_error != ""):
        raise Exception(error)
    
    print(output)
# ---------- end download ----------
toggle = BooleanToggle(False)
wind_speed = WindSpeed(direction=windrose.prevailing, meteo_speed=avr, path=panel_2, run=toggle)  # -> out, speed
# ---------- wind_speed: Python ----------
__author__ = "DarrenLynch"
__version__ = "2021.12.13"

import rhinoscriptsyntax as rs
import subprocess
import ast

def list_to_tree(input, none_and_holes=True, source=[0]):
    """Transforms nestings of lists or tuples to a Grasshopper DataTree"""
    from Grasshopper import DataTree as Tree
    from Grasshopper.Kernel.Data import GH_Path as Path
    from System import Array
    def proc(input,tree,track):
        path = Path(Array[int](track))
        if len(input) == 0 and none_and_holes: tree.EnsurePath(path); return
        for i,item in enumerate(input):
            if hasattr(item, '__iter__'): #if list or tuple
                track.append(i); proc(item,tree,track); track.pop()
            else:
                if none_and_holes: tree.Insert(item,path,i)
                elif item is not None: tree.Add(item,path)
    if input is not None: t=Tree[object]();proc(input,t,source[:]);return t

if _run:
    #Hide the cmd window
    si = subprocess.STARTUPINFO()
    si.dwFlags |= subprocess.STARTF_USESHOWWINDOW
    
    read_speed_code = subprocess.Popen(['simscale-eba',
                                        'cast-speed',
                                         path,
                                         str(direction),
                                         str(meteo_speed)], 
                                         stdout=subprocess.PIPE,
                                         stderr=subprocess.PIPE,
                                         startupinfo=si)
    
    output, error = read_speed_code.communicate()
    output = output.decode("utf-8")
    error = error.decode("utf-8")
    cleaned_error = error.replace("Exception", "")
    
    if (error != None) and (cleaned_error != ""):
        raise Exception(error)
    else:
        speed = list_to_tree(ast.literal_eval(output))
# ---------- end wind_speed ----------
points = Points(path=panel_2, run=toggle)  # -> pt_2, M
flatten = FlattenTree(Tree=points.pt_2, Path="{0}")
geo = Geometry([<brep referenced from the Rhino model> x10])
panel_3 = Panel("""Wind Speed
(m/s)""")
humantosky = LBHumanToSkyRelation(location=importepw.location, position=flatten, context=flatten(geo), parallel=Toggle(True), run=Toggle(False))  # -> report, human_points, human_line, fract_body_exp, sky_exposure; plug-in component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
heatmap = LBSpatialHeatmap(values=wind_speed.speed, mesh=points.M, legend_title=panel_3)  # -> mesh, legend, title, colors, legend_par; plug-in component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
flatten_2 = FlattenTree(Tree=wind_speed.speed, Path="{0}")
outdoorsolarmrt = LBOutdoorSolarMRT(
    location=importepw.location,
    surface_temp=importepw.dry_bulb_temperature,
    dir_norm_rad=importepw.direct_normal_rad,
    diff_horiz_rad=importepw.diffuse_horizontal_rad,
    horiz_infrared=importepw.horizontal_infrared_rad,
    sky_exposure=humantosky.sky_exposure,
    run=Toggle(False))  # -> report, short_erf, long_erf, short_dmrt, long_dmrt, mrt; plug-in component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
unflatten = UnflattenTree(Tree=outdoorsolarmrt.mrt, Guide=points.pt_2)
utci = LBUTCIComfort(
    air_temp=importepw.dry_bulb_temperature,
    mrt=outdoorsolarmrt.mrt,
    rel_humid=importepw.relative_humidity,
    wind_vel=flatten_2,
    run=Toggle(False))  # -> report, utci, comfort, condition, category, comf_obj; plug-in component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
xdata_2 = LBDeconstructData(data=unflatten)  # -> header, values; plug-in component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
avr_2 = Average(Input=xdata_2.values)  # -> flatten(ArithmeticMean)
unflatten_2 = UnflattenTree(Tree=utci.utci, Guide=points.pt_2)
heatmap_2 = LBSpatialHeatmap(values=avr_2, mesh=points.M, legend_title=xdata_2.header)  # -> mesh, legend, title, colors, legend_par; plug-in component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
xdata_3 = LBDeconstructData(data=unflatten_2)  # -> header, values; plug-in component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
avr_3 = Average(Input=xdata_3.values)  # -> flatten(ArithmeticMean)
heatmap_3 = LBSpatialHeatmap(values=avr_3, mesh=points.M, legend_title=xdata_3.header)  # -> mesh, legend, title, colors, legend_par; plug-in component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

# ==== cluster Points
path = ClusterInput()
run = ClusterInput()
points = GhPythonScript(path=path, run=run)  # -> out, X, Y, Z
# ---------- points: Python ----------
__author__ = "DarrenLynch"
__version__ = "2021.12.13"

import rhinoscriptsyntax as rs
import subprocess
import ast

def list_to_tree(input, none_and_holes=True, source=[0]):
    """Transforms nestings of lists or tuples to a Grasshopper DataTree"""
    from Grasshopper import DataTree as Tree
    from Grasshopper.Kernel.Data import GH_Path as Path
    from System import Array
    def proc(input,tree,track):
        path = Path(Array[int](track))
        if len(input) == 0 and none_and_holes: tree.EnsurePath(path); return
        for i,item in enumerate(input):
            if hasattr(item, '__iter__'): #if list or tuple
                track.append(i); proc(item,tree,track); track.pop()
            else:
                if none_and_holes: tree.Insert(item,path,i)
                elif item is not None: tree.Add(item,path)
    if input is not None: t=Tree[object]();proc(input,t,source[:]);return t

if _run:
    #Hide the cmd window
    si = subprocess.STARTUPINFO()
    si.dwFlags |= subprocess.STARTF_USESHOWWINDOW
    
    read_x_code = subprocess.Popen(['simscale-eba',
                                        'cast-ordinate',
                                         path,
                                         'X'],
                                         stdout=subprocess.PIPE,
                                         stderr=subprocess.PIPE,
                                         startupinfo=si)
    
    output, error = read_x_code.communicate()
    output = output.decode("utf-8")
    
    cleaned_error = error.replace("Exception", "")
    
    if (error != None) and (cleaned_error != ""):
        raise Exception(error)
    
    X = list_to_tree(ast.literal_eval(output))
    
    read_y_code = subprocess.Popen(['simscale-eba',
                                        'cast-ordinate',
                                         path,
                                         'Y'],
                                         stdout=subprocess.PIPE,
                                         stderr=subprocess.PIPE,
                                         startupinfo=si)
    
    output, error = read_y_code.communicate()
    output = output.decode("utf-8")
    
    cleaned_error = error.replace("Exception", "")
    
    if (error != None) and (cleaned_error != ""):
        raise Exception(error)
    
    Y = list_to_tree(ast.literal_eval(output))
    
    read_z_code = subprocess.Popen(['simscale-eba',
                                        'cast-ordinate',
                                         path,
                                         'Z'],
                                         stdout=subprocess.PIPE,
                                         stderr=subprocess.PIPE,
                                         startupinfo=si)
    
    output, error = read_z_code.communicate()
    output = output.decode("utf-8")
    
    cleaned_error = error.replace("Exception", "")
    
    if (error != None) and (cleaned_error != ""):
        raise Exception(error)
    
    Z = list_to_tree(ast.literal_eval(output))
# ---------- end points ----------
pt = ConstructPoint(XCoordinate=points.X, YCoordinate=points.Y, ZCoordinate=points.Z)
del = DelaunayMesh(Points=pt, Plane=PlaneXY(0, 0, 0))
pt_2 = ClusterOutput(pt)
M = ClusterOutput(del)
