# Grasshopper definition simple_radiance_utci.gh (Grasshopper 1.0.7)

panel = Panel("https://climate.onebuilding.org/WMO_Region_4_North_and_Central_America/USA_United_States_of_America/MA_Massachusetts/USA_MA_Boston-Logan.Intl.AP.725090_TMYx.2004-2018.zip")
downloadepw = LBDownloadWeather(weather_URL=panel)  # -> epw_file, stat_file, ddy_file; plug-in component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
toggle = BooleanToggle(True)
importddy = LBImportDDY(ddy_file=downloadepw.ddy_file)  # -> location, design_days; plug-in component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
importepw = LBImportEPW(epw_file=downloadepw.epw_file)  # -> location, dry_bulb_temperature, dew_point_temperature, relative_humidity, wind_speed, wind_direction, direct_normal_rad, diffuse_horizontal_rad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; plug-in component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

panel_2 = Panel("E:\Current Cases\Grasshopper Plugin")
download = Download(project="Boston Demo", simulation="Baseline", run="Coarse", resolution="10", path=panel_2, run_2=Toggle(False))  # -> out
# ---------- download: Python ----------
__author__ = "DarrenLynch"
__version__ = "2021.12.10"

import rhinoscriptsyntax as rs
#Start of GH code
import subprocess

if project == None:
    raise Exception("project name is undefined")
if simulation == None:
    raise Exception("simulation name is undefined")
if run == None:
    raise Exception("run name is undefined")
if path == None:
    raise Exception("path is undefined")
if resolution == None:
    raise Exception(
        "resolution is undefined, should be >=0m, but best bellow 10m")
if _run == None:
    raise Exception("_run is undefined, should be boolean")
if not _run:
    string = "to start downloading, toggle _run to True"
    output = string
    raise Warning(string)
    
    
if _run:
    #Hide the cmd window
    si = subprocess.STARTUPINFO()
    si.dwFlags |= subprocess.STARTF_USESHOWWINDOW
    
    ##call the main cli function to download and process results
    download_return_code = subprocess.Popen(['simscale-eba',
                                        'download-pwc-results',
                                         project,
                                         simulation,
                                         run,
                                         str(resolution),
                                         path], 
                                         stdout=subprocess.PIPE,
                                         stderr=subprocess.PIPE,
                                         startupinfo=si)
    
    output, error = download_return_code.communicate()
    output = output.decode("utf-8")
    error = error.decode("utf-8")
    cleaned_error = error.replace("Exception", "")
    
    if (error != None) and (cleaned_error != ""):
        raise Exception(error)
    
    print(output)
# ---------- end download ----------
xdata = LBDeconstructData(data=importepw.wind_speed)  # -> header, values; plug-in component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
xdata_2 = LBDeconstructData(data=importepw.wind_direction)  # -> header, values; plug-in component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
python = GhPythonScript(speeds=xdata.values, directions=xdata_2.values, path=panel_2, run=toggle)  # -> out, names; inputs speeds: list, directions: list
# ---------- python: Python ----------
__author__ = "DarrenLynch"
__version__ = "2022.07.14"

import rhinoscriptsyntax as rs

import csv
import ast
import subprocess

def speed_to_csv(path, speeds, directions):
    s = open(path + r'\speeds.csv', 'w')
    d = open(path + r'\directions.csv', 'w')
    
    speed_writer = csv.writer(s)
    direction_writer = csv.writer(d)
    
    speed_writer.writerow(speeds)
    direction_writer.writerow(directions)
    
    s.close()
    d.close()
    
def list_to_tree(input, none_and_holes=True, source=[0]):
    """Transforms nestings of lists or tuples to a Grasshopper DataTree"""
    from Grasshopper import DataTree as Tree
    from Grasshopper.Kernel.Data import GH_Path as Path
    from System import Array
    def proc(input, tree, track):
        path = Path(Array[int](track))
        if len(input) == 0 and none_and_holes: tree.EnsurePath(path); return
        for i, item in enumerate(input):
            if hasattr(item, '__iter__'):  # if list or tuple
                track.append(i);
                proc(item, tree, track);
                track.pop()
            else:
                if none_and_holes:
                    tree.Insert(item, path, i)
                elif item is not None:
                    tree.Add(item, path)

    if input is not None: t = Tree[object]();proc(input, t, source[:]);return t

speed_to_csv(path, speeds, directions)

if _run:
    # Hide the cmd window
    si = subprocess.STARTUPINFO()
    si.dwFlags |= subprocess.STARTF_USESHOWWINDOW

    read_speed_code = subprocess.Popen(['simscale-eba',
                                        'create-speed-matrix',
                                        path],
                                        stdout=subprocess.PIPE,
                                        stderr=subprocess.PIPE,
                                        startupinfo=si)

    output, error = read_speed_code.communicate()
    output = output.decode("utf-8")
    error = error.decode("utf-8")
    cleaned_error = error.replace("Exception", "")

    if (error != None) and (cleaned_error != ""):
        raise Exception(error)
    else:
        speed = list_to_tree(ast.literal_eval(output))
# ---------- end python ----------
points = Points(path=panel_2, run=toggle)  # -> pt_2, M

windrose = LBWindRose(wind_direction=importepw.wind_direction)  # -> report, mesh, compass, orient_line, freq_line, windrose_line, legend, title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; plug-in component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

geo = Geometry([<brep referenced from the Rhino model> x204])
shade = HBShade(geo=geo)  # -> report, shades; plug-in component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
model = HBModel(shades=flatten(shade.shades))  # -> report, model; plug-in component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
sensorgrid = HBSensorGrid(positions=points.pt_2)  # -> grid; plug-in component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
assigngridsviews = HBAssignGridsAndViews(model=model.model, grids=flatten(sensorgrid))  # -> model; plug-in component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

utcimap = HBUTCIComfortMap(model=assigngridsviews, epw=downloadepw.epw_file, ddy=downloadepw.ddy_file, run=Toggle(False))  # -> report, env_conds, utci, condition, category, TCP, HSP, CSP; plug-in component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
thermalmtx = HBReadThermalMatrix(comf_result=utcimap.utci, load=Toggle(False))  # -> comf_mtx; plug-in component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
vizthermalmap = HBVisualizeThermalMap(comf_mtx=thermalmtx, mesh=flatten(points.M))  # -> report, mesh, legend, title, colors, values; plug-in component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

# ==== cluster Points
path = ClusterInput()
run = ClusterInput()
points = GhPythonScript(path=path, run=run)  # -> out, X, Y, Z
# ---------- points: Python ----------
__author__ = "DarrenLynch"
__version__ = "2021.12.13"

import rhinoscriptsyntax as rs
import subprocess
import ast

def list_to_tree(input, none_and_holes=True, source=[0]):
    """Transforms nestings of lists or tuples to a Grasshopper DataTree"""
    from Grasshopper import DataTree as Tree
    from Grasshopper.Kernel.Data import GH_Path as Path
    from System import Array
    def proc(input,tree,track):
        path = Path(Array[int](track))
        if len(input) == 0 and none_and_holes: tree.EnsurePath(path); return
        for i,item in enumerate(input):
            if hasattr(item, '__iter__'): #if list or tuple
                track.append(i); proc(item,tree,track); track.pop()
            else:
                if none_and_holes: tree.Insert(item,path,i)
                elif item is not None: tree.Add(item,path)
    if input is not None: t=Tree[object]();proc(input,t,source[:]);return t

if _run:
    #Hide the cmd window
    si = subprocess.STARTUPINFO()
    si.dwFlags |= subprocess.STARTF_USESHOWWINDOW
    
    read_x_code = subprocess.Popen(['simscale-eba',
                                        'cast-ordinate',
                                         path,
                                         'X'],
                                         stdout=subprocess.PIPE,
                                         stderr=subprocess.PIPE,
                                         startupinfo=si)
    
    output, error = read_x_code.communicate()
    output = output.decode("utf-8")
    
    cleaned_error = error.replace("Exception", "")
    
    if (error != None) and (cleaned_error != ""):
        raise Exception(error)
    
    X = list_to_tree(ast.literal_eval(output))
    
    read_y_code = subprocess.Popen(['simscale-eba',
                                        'cast-ordinate',
                                         path,
                                         'Y'],
                                         stdout=subprocess.PIPE,
                                         stderr=subprocess.PIPE,
                                         startupinfo=si)
    
    output, error = read_y_code.communicate()
    output = output.decode("utf-8")
    
    cleaned_error = error.replace("Exception", "")
    
    if (error != None) and (cleaned_error != ""):
        raise Exception(error)
    
    Y = list_to_tree(ast.literal_eval(output))
    
    read_z_code = subprocess.Popen(['simscale-eba',
                                        'cast-ordinate',
                                         path,
                                         'Z'],
                                         stdout=subprocess.PIPE,
                                         stderr=subprocess.PIPE,
                                         startupinfo=si)
    
    output, error = read_z_code.communicate()
    output = output.decode("utf-8")
    
    cleaned_error = error.replace("Exception", "")
    
    if (error != None) and (cleaned_error != ""):
        raise Exception(error)
    
    Z = list_to_tree(ast.literal_eval(output))
# ---------- end points ----------
pt = ConstructPoint(XCoordinate=points.X, YCoordinate=points.Y, ZCoordinate=points.Z)
del = DelaunayMesh(Points=pt, Plane=PlaneXY(0, 0, 0))
pt_2 = ClusterOutput(pt)
M = ClusterOutput(del)
