# Grasshopper definition simple_result_vis.gh (Grasshopper 1.0.7)

panel = Panel("E:\Current Cases\Grasshopper Plugin")
download = Download(
    project="Outdoor Comfort Example",
    simulation="Pedestrian Wind Comfort",
    run="Run 1",
    resolution="10",
    path=panel,
    run_2=Toggle(False))  # -> out
# ---------- download: Python ----------
__author__ = "DarrenLynch"
__version__ = "2021.12.10"

import rhinoscriptsyntax as rs
#Start of GH code
import subprocess

if project == None:
    raise Exception("project name is undefined")
if simulation == None:
    raise Exception("simulation name is undefined")
if run == None:
    raise Exception("run name is undefined")
if path == None:
    raise Exception("path is undefined")
if resolution == None:
    raise Exception(
        "resolution is undefined, should be >=0m, but best bellow 10m")
if _run == None:
    raise Exception("_run is undefined, should be boolean")
if not _run:
    string = "to start downloading, toggle _run to True"
    output = string
    raise Warning(string)
    
    
if _run:
    #Hide the cmd window
    si = subprocess.STARTUPINFO()
    si.dwFlags |= subprocess.STARTF_USESHOWWINDOW
    
    ##call the main cli function to download and process results
    download_return_code = subprocess.Popen(['simscale-eba',
                                        'download-pwc-results',
                                         project,
                                         simulation,
                                         run,
                                         str(resolution),
                                         path], 
                                         stdout=subprocess.PIPE,
                                         stderr=subprocess.PIPE,
                                         startupinfo=si)
    
    output, error = download_return_code.communicate()
    output = output.decode("utf-8")
    error = error.decode("utf-8")
    cleaned_error = error.replace("Exception", "")
    
    if (error != None) and (cleaned_error != ""):
        raise Exception(error)
    
    print(output)
# ---------- end download ----------
panel_2 = Panel(download)
toggle = BooleanToggle(False)
points = Points(path=panel, run=toggle)  # -> pt_2, M
wind_speed = WindSpeed(direction="45", meteo_speed="10", path=panel, run=toggle)  # -> out, speed
# ---------- wind_speed: Python ----------
__author__ = "DarrenLynch"
__version__ = "2021.12.13"

import rhinoscriptsyntax as rs
import subprocess
import ast

def list_to_tree(input, none_and_holes=True, source=[0]):
    """Transforms nestings of lists or tuples to a Grasshopper DataTree"""
    from Grasshopper import DataTree as Tree
    from Grasshopper.Kernel.Data import GH_Path as Path
    from System import Array
    def proc(input,tree,track):
        path = Path(Array[int](track))
        if len(input) == 0 and none_and_holes: tree.EnsurePath(path); return
        for i,item in enumerate(input):
            if hasattr(item, '__iter__'): #if list or tuple
                track.append(i); proc(item,tree,track); track.pop()
            else:
                if none_and_holes: tree.Insert(item,path,i)
                elif item is not None: tree.Add(item,path)
    if input is not None: t=Tree[object]();proc(input,t,source[:]);return t

if _run:
    #Hide the cmd window
    si = subprocess.STARTUPINFO()
    si.dwFlags |= subprocess.STARTF_USESHOWWINDOW
    
    read_speed_code = subprocess.Popen(['simscale-eba',
                                        'cast-speed',
                                         path,
                                         str(direction),
                                         str(meteo_speed)], 
                                         stdout=subprocess.PIPE,
                                         stderr=subprocess.PIPE,
                                         startupinfo=si)
    
    output, error = read_speed_code.communicate()
    output = output.decode("utf-8")
    error = error.decode("utf-8")
    cleaned_error = error.replace("Exception", "")
    
    if (error != None) and (cleaned_error != ""):
        raise Exception(error)
    else:
        speed = list_to_tree(ast.literal_eval(output))
# ---------- end wind_speed ----------
panel_3 = Panel(wind_speed.speed)
panel_4 = Panel(points.pt_2)
panel_5 = Panel(points.M)
heatmap = LBSpatialHeatmap(values=wind_speed.speed, mesh=points.M)  # -> mesh, legend, title, colors, legend_par; plug-in component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

# ==== cluster Points
path = ClusterInput()
run = ClusterInput()
points = GhPythonScript(path=path, run=run)  # -> out, X, Y, Z
# ---------- points: Python ----------
__author__ = "DarrenLynch"
__version__ = "2021.12.13"

import rhinoscriptsyntax as rs
import subprocess
import ast

def list_to_tree(input, none_and_holes=True, source=[0]):
    """Transforms nestings of lists or tuples to a Grasshopper DataTree"""
    from Grasshopper import DataTree as Tree
    from Grasshopper.Kernel.Data import GH_Path as Path
    from System import Array
    def proc(input,tree,track):
        path = Path(Array[int](track))
        if len(input) == 0 and none_and_holes: tree.EnsurePath(path); return
        for i,item in enumerate(input):
            if hasattr(item, '__iter__'): #if list or tuple
                track.append(i); proc(item,tree,track); track.pop()
            else:
                if none_and_holes: tree.Insert(item,path,i)
                elif item is not None: tree.Add(item,path)
    if input is not None: t=Tree[object]();proc(input,t,source[:]);return t

if _run:
    #Hide the cmd window
    si = subprocess.STARTUPINFO()
    si.dwFlags |= subprocess.STARTF_USESHOWWINDOW
    
    read_x_code = subprocess.Popen(['simscale-eba',
                                        'cast-ordinate',
                                         path,
                                         'X'],
                                         stdout=subprocess.PIPE,
                                         stderr=subprocess.PIPE,
                                         startupinfo=si)
    
    output, error = read_x_code.communicate()
    output = output.decode("utf-8")
    
    cleaned_error = error.replace("Exception", "")
    
    if (error != None) and (cleaned_error != ""):
        raise Exception(error)
    
    X = list_to_tree(ast.literal_eval(output))
    
    read_y_code = subprocess.Popen(['simscale-eba',
                                        'cast-ordinate',
                                         path,
                                         'Y'],
                                         stdout=subprocess.PIPE,
                                         stderr=subprocess.PIPE,
                                         startupinfo=si)
    
    output, error = read_y_code.communicate()
    output = output.decode("utf-8")
    
    cleaned_error = error.replace("Exception", "")
    
    if (error != None) and (cleaned_error != ""):
        raise Exception(error)
    
    Y = list_to_tree(ast.literal_eval(output))
    
    read_z_code = subprocess.Popen(['simscale-eba',
                                        'cast-ordinate',
                                         path,
                                         'Z'],
                                         stdout=subprocess.PIPE,
                                         stderr=subprocess.PIPE,
                                         startupinfo=si)
    
    output, error = read_z_code.communicate()
    output = output.decode("utf-8")
    
    cleaned_error = error.replace("Exception", "")
    
    if (error != None) and (cleaned_error != ""):
        raise Exception(error)
    
    Z = list_to_tree(ast.literal_eval(output))
# ---------- end points ----------
pt = ConstructPoint(XCoordinate=points.X, YCoordinate=points.Y, ZCoordinate=points.Z)
del = DelaunayMesh(Points=pt, Plane=PlaneXY(0, 0, 0))
pt_2 = ClusterOutput(pt)
M = ClusterOutput(del)
