# Grasshopper definition lb_points.gh (Grasshopper 1.0.7)

geo = Geometry(<brep referenced from the Rhino model>)
genpts = LBGeneratePointGrid(geometry=geo, grid_size="5", quad_only=Toggle(True))  # -> points, vectors, face_areas, graft(mesh); plug-in component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
panel = Panel(genpts.points)
